# Dynamo graph parking-symbols.dyn (Dynamo 2.18.1.5096)

# group: Export JSON File
select_face = DSFaceSelection()  # 1 picked in the model
file_path = Filename(".\noParkingSymbol.json")
select_faces = SelectFaces()  # 2 picked in the model
toSolidDef = Geometry.ToSolidDef(geometry=select_faces)
stringifyJSON = Data.StringifyJSON(values=toSolidDef, lacing=CrossProduct)
writeText = FileSystem.WriteText(filePath=file_path, text=stringifyJSON, lacing=Longest)
